# Grasshopper definition DayLightAnalysis.gh (Grasshopper 1.0.7)
# plug-ins: Pufferfish, froGH, ToggleV6, LINK_Dashboards, MetaHopper

rectangle = Rectangle({Plane=PlaneXY(14.45158899, 7.050788778, 0), Size=Domain2(u=-5..5, v=-5..5)})
nofwindow = Slider(2, range=0..10)
unit_z = UnitZ(Factor=Slider(20, range=0..100))
move = Move(Geometry=rectangle, Motion=unit_z)  # -> Geometry, Transform
explode = Explode(Curve=move.Geometry, Recursive=True)  # -> graft(Segments), Vertices
range = Range(Domain=Domain(0, 1), Steps=nofwindow)
list_item = ListItem(List=flatten(explode.Segments), Index=0, Wrap=True)
tween_consecutive_numbers = TweenConsecutiveNumbers(Numbers=range, Factor=0.5, Loopback=False)
evaluate_curve = EvaluateCurve(Curve=reparameterize(list_item), Parameter=tween_consecutive_numbers)  # -> Point, Tangent, Angle
sillheight = Slider(0.7, range=0..1)
unit_z_2 = UnitZ(Factor=sillheight)
boundary_surfaces = BoundarySurfaces(Edges=move.Geometry)
unit_z_3 = UnitZ(Factor=1)
construct_plane = ConstructPlane(Origin=evaluate_curve.Point, XAxis=evaluate_curve.Tangent, YAxis=unit_z_3)
move_2 = Move(Geometry=construct_plane, Motion=unit_z_2)  # -> Geometry, Transform
unit_z_4 = UnitZ(Factor=Slider(4, range=0..10))
move_3 = Move(Geometry=boundary_surfaces, Motion=unit_z_4)  # -> Geometry, Transform
extrude = Extrude(Base=move.Geometry, Direction=unit_z_4)
boundary_surfaces_2 = BoundarySurfaces(Edges=move.Geometry)
curve = Curve(<curve referenced from the Rhino model>)
shade = HBShade(geo=move_3.Geometry)  # -> out, shades; plug-in component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
cap_holes = CapHoles(Brep=extrude)
centered_domain = CenteredDomain(DomainLength=Slider(1.2, range=0..10))
rectangle_2 = Rectangle(Plane=move_2.Geometry, XSize=centered_domain, YSize=Slider(2.06, range=0..10), Radius=0)  # -> flatten(Rectangle), Length
mesh_shadow = MeshShadow(Mesh=rectangle_2.Rectangle, Light=curve, Plane=boundary_surfaces_2)  # -> flatten(Outlines)
glassmod = HBGlassModifier(name="Glass", trans=Slider(0.7, range=0..1))  # -> modifier; plug-in component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
roomsolid = HBRoomFromSolid(geo=flatten(cap_holes), conditioned=True)  # -> out, rooms; plug-in component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
boundary_surfaces_3 = BoundarySurfaces(Edges=rectangle_2.Rectangle)
boundary_surfaces_4 = BoundarySurfaces(Edges=flatten([mesh_shadow, move.Geometry]))
aperture = HBAperture(geo=boundary_surfaces_3, rad_mod=glassmod)  # -> out, apertures; plug-in component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
addsubface = HBAddSubface(hb_obj=flatten(roomsolid.rooms), sub_faces=flatten(aperture.apertures))  # -> hb_obj; plug-in component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
louvershades = HBLouverShades(hb_objs=flatten(addsubface), depth=Slider(1, range=0..1), shade_count=Slider(1, range=0..10))  # -> readMe, hb_objs; disabled; plug-in component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
gridrooms = HBSensorGridFromRooms(rooms=roomsolid.rooms, grid_size=Slider(0.5, range=0..1), dist_floor=Slider(0.1, range=0..0.1))  # -> grid, points, mesh; plug-in component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
model = HBModel(rooms=flatten(addsubface), shades=flatten(shade.shades))  # -> out, model; plug-in component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
vizwiref = HBVisualizeWireframe(hb_objs=flatten(model.model))  # -> geo; plug-in component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
assigngridsviews = HBAssignGridsAndViews(model=model.model, grids=flatten(gridrooms.grid))  # -> model; plug-in component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
file_path = FilePath("R:\ASSEST\EPW\VNM_NVN_Hanoi-Noi.Bai.Intl.AP.488200_TMYx.2004-2018.epw")
analysisperiod = LBAnalysisPeriod(start_month=1, start_day=1, start_hour=Slider(8, range=0..10), end_hour=Slider(18, range=0..100))  # -> period, hoys, dates; plug-in component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
wea = HBWeaFromEPW(epw_file=file_path, hoys=analysisperiod.hoys)  # -> wea; plug-in component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
daylightfactor = HBDaylightFactor(model=assigngridsviews, run=Toggle(SpecialInteger=True))  # -> out, results; plug-in component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
directsunhours = HBDirectSunHours(model=assigngridsviews, wea=wea, run=Toggle(SpecialInteger=False))  # -> out, results, hours; plug-in component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
annualirradiance = HBAnnualIrradiance(model=assigngridsviews, wea=wea, run=Toggle(SpecialInteger=True))  # -> out, results, res_direct, avg_irr, peak_irr, radiation; plug-in component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
annualdaylight = HBAnnualDaylight(model=assigngridsviews, wea=wea, run=Toggle(SpecialInteger=True))  # -> out, results, DA, cDA, UDI, UDI_low, UDI_up; plug-in component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
heatmap = LBSpatialHeatmap(values=daylightfactor.results, mesh=gridrooms.mesh, legend_title="DaylightFactor(%)")  # -> mesh, legend, title, colors, legend_par, vis_set; disabled; plug-in component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
visset = LBPreviewVisualizationSet(vis_set=flatten(heatmap.vis_set))  # -> vs; plug-in component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

panel = Panel("""Daylight
Autonomy(%)""")  # disabled
group_toggle = GroupToggle(ToggleActive=True, ToggleVisible=False)  # disabled
heatmap_2 = LBSpatialHeatmap(values=annualdaylight.DA, mesh=gridrooms.mesh, legend_title=panel)  # -> mesh, legend, title, colors, legend_par, vis_set; disabled; plug-in component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
face_normals = FaceNormals(Mesh=heatmap_2.mesh)  # -> Centers, Normals; disabled
number_slider = Slider(0.12, range=0..1)  # disabled
colour_swatch = ColourSwatch(SwatchColor=RGB(255, 255, 255))  # disabled
text_tag_3d = TextTag3D(Location=face_normals.Centers, Text=annualdaylight.DA, Size=number_slider, Colour=colour_swatch, Justification=5)  # disabled

# ----
# AnnualSunlightExposure
ase = HBAnnualSunlightExposure(results=annualdaylight.results, threshold=Slider(1000, range=0..1000), target_hrs=Slider(250, range=0..1000))  # -> out, ASE, hrs_above; plug-in component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
# Spatial Daylight Autonomy
sda = HBSpatialDaylightAutonomy(DA=annualdaylight.DA, mesh=gridrooms.mesh)  # -> out, sDA, pass_fail; plug-in component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
multiplication = Multiplication(A=sda.sDA, B=100)
# ASE: Annual Sunlight Exposure (ASE) refers to the percentage of space that receives too much direct sunlight (1000 Lux or more for at least 250 occupied hours per year) at the work plane height, which can cause glare or increased cooling loads
portion_of_space_with_250_hours = Panel(ase.ASE)
# sDA: describes the percentage of floor area that receives at least 300 lux for at least 50% of the annual occupied hours (8am-6pm) on the horizontal work plane
percentage_of_floor_area = Panel(multiplication)
concatenate = Concatenate(FragmentA="+", FragmentB=ase.hrs_above)

group_toggle_2 = GroupToggle(ToggleActive=True, ToggleVisible=False)  # disabled
panel_2 = Panel("ASE>250(hrs)")  # disabled
heatmap_3 = LBSpatialHeatmap(values=ase.hrs_above, mesh=gridrooms.mesh, legend_title=panel_2)  # -> mesh, legend, title, colors, legend_par, vis_set; disabled; plug-in component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
number_slider_2 = Slider(0.12, range=0..1)  # disabled
face_normals_2 = FaceNormals(Mesh=heatmap_3.mesh)  # -> Centers, Normals; disabled
colour_swatch_2 = ColourSwatch(SwatchColor=RGB(255, 255, 255))  # disabled
text_tag_3d_2 = TextTag3D(Location=face_normals_2.Centers, Text=concatenate, Size=number_slider_2, Colour=colour_swatch_2, Justification=5)  # disabled

heatmap_4 = LBSpatialHeatmap(values=annualirradiance.radiation, mesh=gridrooms.mesh, legend_title=panel_2)  # -> mesh, legend, title, colors, legend_par, vis_set; plug-in component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
visset_2 = LBPreviewVisualizationSet(vis_set=flatten(heatmap_3.vis_set))  # -> vs; plug-in component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
# ASE < 10% -> Pass: For LEED v4, no more than 10% of a space should have direct sunlight more than 1000 lux for a maximum period of 250 hours per year (ASE1000/250)
visset_3 = LBPreviewVisualizationSet(vis_set=flatten(heatmap_2.vis_set))  # -> vs; plug-in component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
panel_3 = Panel(""">=55% -> 2pt
>=75% -> 3pt""")
merge = Merge(Data1=flatten(percentage_of_floor_area), Data2=flatten(portion_of_space_with_250_hours))
panel_4 = Panel("""sDA
ASE""")
link_dashboard_item = LINKDashboardItem(
    Name=panel_4,
    Value=merge,
    _MinValue="100",
    _MaxValue=100,
    _Color=ColourSwatch(SwatchColor=RGB(0, 0, 0)),
    _ShowSub=True,
    _units="%",
    _decimals=1,
    _showValues=invert(False),
    _MeshTransparency=-1,
    _ShowChildGeometries=0)
link_dashboard_properties = LINKDashboardProperties(
    _Width=Slider(92, range=0..100),
    _Scale=Slider(2.5, range=0..10),
    _FontSize=-1,
    _Padding=-1,
    _LineHeight=-1,
    _HorizontalOffset=-1,
    _Frame=-1,
    _TextVerticalOffset=0,
    _AllViewports=False,
    _ShowTargets=True,
    _BackgroundOpacity=0.4,
    _ExtraPaddingAfterNested=3.5,
    _ShowPins=True)
link_dashboard_show = LINKDashboardShow(
    Items=flatten(link_dashboard_item),
    _Properties=link_dashboard_properties,
    _Enable=True,
    OverrideAnchor=False,
    OverrideAnchorX=0,
    OverrideAnchorY=0)  # disabled
