# Grasshopper definition FilterMask.gh (Grasshopper 1.0.7)
# plug-ins: BitmapPlus, Human, Heteroptera

file_path = FilePath("G:\My Drive\IAAC\IAAC\Module3\Studio\Pix2Pix\data\facades\train\")
directory_contents = DirectoryContents(FolderPath=file_path, Filter="*", IncludeSubfolders=False)  # -> FilePaths, FileNames
list_length = ListLength(List=directory_contents.FilePaths)
number_slider = Slider(256, range=0..1000)
series = Series(Start=0, Step=1, Count=list_length)
trigger = Trigger(Interval=1000, TimerInterval=1000, Target=[oil_can, boolean_toggle])  # disabled
oil_can = OilCan(DataList=series, Reset=Button(), Drop=True, DropMode=2)
list_item = ListItem(List=directory_contents.FilePaths, Index=oil_can, Wrap=True)
open_bitmap = OpenBitmap(FilePath=list_item, Load=Toggle(True))
multiplication = Multiplication(A=number_slider, B="2")
construct_domain = ConstructDomain(DomainStart=Slider(0, range=0..1000), DomainEnd=number_slider)
construct_domain_2 = ConstructDomain(DomainStart=number_slider, DomainEnd=multiplication)
panel = Panel(oil_can)
rectangle = Rectangle(Plane=PlaneXY(0, 0, 0), XSize=construct_domain_2, YSize=construct_domain, Radius=0)  # -> Rectangle, Length
crop_image = CropImage(Image=open_bitmap, Region=rectangle.Rectangle, KeepOriginal=invert(True), Color=RGBA(255, 255, 255, 0))
construct_domain_3 = ConstructDomain(DomainStart=Slider(0.436, range=0..1), DomainEnd=Slider(0.605, range=0..1))
construct_domain_4 = ConstructDomain(DomainStart=Slider(0, range=0..1), DomainEnd=Slider(0, range=0..1))
construct_domain_5 = ConstructDomain(DomainStart=Slider(0, range=0..1), DomainEnd=Slider(0, range=0..1))
format = Format(Format="OpeningMasked_{0}", Culture=127, Data0=oil_can)
filtering_filter = FilteringFilter(
    Image=crop_image,
    Mode=0,
    Red=construct_domain_5,
    Green=construct_domain_3,
    Blue=construct_domain_4,
    Outside=True,
    Color=RGB(0, 0, 0))
boolean_toggle = BooleanToggle(True)
foldertosave = Panel("E:\Desktop\New folder\")
imgname = Panel(format)
threshold_filter = ThresholdFilter(Image=filtering_filter, Mode=5, Range=Slider(0.07, range=0..1), K=0.5, Radius=1)
extract_filter = ExtractFilter(Image=threshold_filter, Mode=1)
save_bitmap = SaveBitmap(ImageBitmap=extract_filter, FolderPath=foldertosave, FileName=imgname, Extension=0, Save=boolean_toggle)
evaluate_bitmap = EvaluateBitmap(Image=extract_filter, UParameter=0.5, VParameter=0.5)
prev_image = PrevImage(SmartBitmap=crop_image)
prev_image_2 = PrevImage(SmartBitmap=extract_filter)
